# Grasshopper definition 160401_IKsimulation.gh (Grasshopper 0.9.76)
# plug-ins: Python Interpreter

panel = Panel("""{0,800,0}
{800,800,0}""")
panel_2 = Panel("""46.2
46.2
46.2
46.2""")
domain = Domain("-45 to 45")
dedomain = DeconstructDomain(Domain=domain)  # -> Start, End
domain_2 = Domain("-45 to 45")
dedomain_2 = DeconstructDomain(Domain=domain_2)  # -> Start, End
domain_3 = Domain("-1099.0 to 1099.0")
dedomain_3 = DeconstructDomain(Domain=domain_3)  # -> Start, End
domain_4 = Domain("-2054.0 to 2054.0")
dedomain_4 = DeconstructDomain(Domain=domain_4)  # -> Start, End

# ---- group: gondola_top
num = Number(dedomain.End)

# ---- group: gondola_bottom
num_2 = Number(dedomain.Start)

# ---- group: gondola_right
num_3 = Number(dedomain_2.End)

# ---- group: gondola_left
num_4 = Number(dedomain_2.Start)

# ---- group: SPOOL_DIAMETER
num_5 = Number(panel_2)

# ---- group: posx
num_6 = Number(Slider(1000, range=-1500..1500))

# ---- group: posy
num_7 = Number(Slider(0, range=-500..500))

# ---- group: limit_top
num_8 = Number(dedomain_3.End)

# ---- group: limit_bottom
num_9 = Number(dedomain_3.Start)

# ---- group: limit_right
num_10 = Number(dedomain_4.End)

# ---- group: limit_left
num_11 = Number(dedomain_4.Start)

# ----
pt = ConstructPoint(XCoordinate=num_6, YCoordinate=num_7, ZCoordinate=0)

# ---- group: gondola_top
num_12 = Number(num)

# ---- group: gondola_bottom
num_13 = Number(num_2)

# ---- group: gondola_right
num_14 = Number(num_3)

# ---- group: gondola_left
num_15 = Number(num_4)

# ---- group: SPOOL_DIAMETER
num_16 = Number(num_5)

# ---- group: posx
num_17 = Number(num_6)

# ---- group: posy
num_18 = Number(num_7)

# ---- group: limit_top
num_19 = Number(num_8)

# ---- group: limit_bottom
num_20 = Number(num_9)

# ---- group: limit_right
num_21 = Number(num_10)

# ---- group: limit_left
num_22 = Number(num_11)

# ----
rectangle = Rectangle(Plane=PlaneXY(0, 0, 0), XSize=domain_4, YSize=domain_3, Radius=0)  # -> Rectangle, Length

# ---- group: pos (x,y)
pt_2 = Point(panel)

# ----
rectangle_2 = Rectangle(Plane=pt_2, XSize=domain_2, YSize=domain, Radius=0)  # -> Rectangle, Length

# ---- group: Canvas
crv = Curve(rectangle_2.Rectangle)

crv_2 = Curve(rectangle.Rectangle)

# ----
cp = ControlPoints(Curve=crv)  # -> reverse(Points), Weights, Knots
cp_2 = ControlPoints(Curve=crv_2)  # -> reverse(Points), Weights, Knots
cull_i = CullIndex(List=cp_2.Points, Indices="0", Wrap=True)
x = Number(expr("x*0.5", num_5))
cull_i_2 = CullIndex(List=cp.Points, Indices="0", Wrap=True)
cir = Circle(Plane=cull_i, Radius=x)
eval = Evaluate(F="limit_bottom - gondola_bottom - y", y=num_18, limit_bottom=num_20, gondola_bottom=num_13)
eval_2 = Evaluate(F="limit_right - gondola_right - x", x=num_17, limit_right=num_21, gondola_right=num_14)
eval_3 = Evaluate(F="limit_top - gondola_top - y", y=num_18, limit_top=num_19, gondola_top=num_12)
eval_4 = Evaluate(F="limit_left - gondola_left - x", x=num_17, limit_left=num_22, gondola_left=num_15)
tan = TangentLines(Point=cull_i_2, Circle=cir)  # -> Tangent1, Tangent2
ln = Line(StartPoint=cull_i, EndPoint=cull_i_2)

# ---- group: dy_up
num_23 = Number(eval_3)

# ---- group: dy_dn
num_24 = Number(eval)

# ---- group: dx_r
num_25 = Number(eval_2)

# ---- group: dx_l
num_26 = Number(eval_4)

# ----
bang = ExplodeTree(Data=simplify(graft(num_16)))  # -> Branch0, Branch1, Branch2, Branch3
item = ListItem(List=tan.Tangent2, Index="1", Wrap=True)
item_2 = ListItem(List=tan.Tangent2, Index="3", Wrap=True)
item_3 = ListItem(List=tan.Tangent1, Index="0", Wrap=True)
item_4 = ListItem(List=tan.Tangent1, Index="2", Wrap=True)
eval_5 = Evaluate(F=" sqrt( dx*dx + dy*dy)", dx=num_26, dy=num_23)
merge = Merge(Data1=item_3, Data2=item, Data3=item_4, Data4=item_2)

# ---- group: L1, L2, L3, L4
crv_3 = Curve(merge)

# ----
panel_3 = Panel("""0
1""")
eval_6 = Evaluate(F="sqrt( (dx*dx + dy*dy) - (spool/2.0)*(spool/2.0) )", dx=num_26, dy=num_24, spool=bang.Branch3)
eval_7 = Evaluate(F="sqrt( (dx*dx + dy*dy) - (spool/2.0)*(spool/2.0) )", dx=num_26, dy=num_23, spool=bang.Branch0)
eval_8 = Evaluate(F="sqrt( (dx*dx + dy*dy) - (spool/2.0)*(spool/2.0) )", dx=num_25, dy=num_23, spool=bang.Branch1)
eval_9 = Evaluate(F="sqrt( (dx*dx + dy*dy) - (spool/2.0)*(spool/2.0) )", dx=num_25, dy=num_24, spool=bang.Branch2)
len = Length(Curve=crv_3)
panel_4 = Panel(len)
item_5 = ListItem(List=len, Index=panel_3, Wrap=True)

# ---- group: L4
num_27 = Number(eval_6)

# ---- group: L1
num_28 = Number(eval_7)

# ---- group: L2
num_29 = Number(eval_8)

# ---- group: L3
num_30 = Number(eval_9)

# ----
num_31 = Number([2218.723964, 2218.723964, 2218.723964, 2218.723964])
panel_5 = Panel(item_5)
panel_6 = Panel(num_31)
int = Integer(num_31)
merge_2 = Merge(Data1=num_28, Data2=num_29, Data3=num_30, Data4=num_27)  # -> flatten(Result)
subtraction = Subtraction(A=len, B=num_31)
panel_7 = Panel(subtraction)

# ---- group: L1, L2, L3, L4
num_32 = Number(merge_2)

# ----
number_slider = Slider(3.55214, range=-100..100)
number_slider_2 = Slider(0.00181, range=-100..100)
number_slider_3 = Slider(2e-05, range=-100..100)
python = PythonScript(x=subtraction)  # -> out, a
# ---------- python: Python ----------
if (x >= 0):
    a = 1
else:
    a = -1
# ---------- end python ----------
item_6 = ListItem(List=panel_2, Index=0, Wrap=True)
subtraction_2 = Subtraction(A=len, B=num_32)
galapagos = Galapagos(fitness=ma, gene=[number_slider_3, number_slider_2, number_slider])
panel_8 = Panel(subtraction_2)
python_2 = PythonScript(dir=python.a, Do=Slider(45.9, range=25.5..100), d_L=subtraction, t=Slider(-0.04, range=-10.1..2))  # -> out, STEPS, N, D1
# ---------- python_2: Python ----------
import math

#Do = 46.2
#t = 0.43
pi = 3.14159265359
STEPS_PER_TURN = 3200

N = (t - Do + math.sqrt( (Do - t)**2  + ((4 * t * abs(d_L)) / pi)) ) / (2 * t)

N *= dir

STEPS = math.floor( N * STEPS_PER_TURN )

D1 = 2*N*t + Do
# ---------- end python_2 ----------
python_3 = PythonScript(x=subtraction, a=number_slider_3, b=number_slider_2, c=number_slider)  # -> out, step
# ---------- python_3: Python ----------
step = a*(x**3) + b*(x**2) + c*x
# ---------- end python_3 ----------
panel_9 = Panel(python_2.N)
int_2 = Integer(python_3.step)
panel_10 = Panel(python_2.D1)
panel_11 = Panel(python_3.step)
panel_12 = Panel("""0
1""")
item_7 = ListItem(List=python_3.step, Index=panel_12, Wrap=True)  # -> simplify(Item)
panel_13 = Panel("""0
0
21180
-15865
17465
-22771
-4543
-4543
6841
6841
26678
-7390""")
partition = PartitionList(List=panel_13, Size="2")  # -> simplify(Chunks)
panel_14 = Panel(item_7)
subtraction_3 = Subtraction(A=partition, B=item_7)
sqr = Square(Value=subtraction_3)
ma = MassAddition(Input=flatten(sqr))  # -> Result, PartialResults
panel_15 = Panel(ma.Result)
